# Dynamo graph ExportFramingCSV.dyn (Dynamo 2.10.1.3976)

file_path = Filename("ETABS\CSV\RevitExport.csv")  # graph input
get_beam_and_columns = Python()  # IronPython2; unwired: IN[0]
# ---------- get_beam_and_columns.python (53 lines) ----------
# Load the Python Standard and DesignScript Libraries
import sys
import clr

clr.AddReference("RevitAPI")
from Autodesk.Revit.DB import *

clr.AddReference("RevitAPIUI")
from Autodesk.Revit.UI import *

clr.AddReference('RevitServices')
from RevitServices.Persistence import DocumentManager
from RevitServices.Transactions import TransactionManager

# Import RevitNodes
clr.AddReference("RevitNodes")
import Revit
#from Revit.Elements import *
clr.ImportExtensions(Revit.Elements)
clr.ImportExtensions(Revit.GeometryConversion)


dataEnteringNode = IN
doc = DocumentManager.Instance.CurrentDBDocument
beams = FilteredElementCollector(doc).OfCategory(BuiltInCategory.OST_StructuralFraming).WhereElementIsNotElementType()
columns = FilteredElementCollector(doc).OfCategory(BuiltInCategory.OST_StructuralColumns).WhereElementIsNotElementType()

data = []
eles = []
err = []
for b in beams:
	lc = b.Location
	try:
		end0 = lc.Curve.GetEndPoint(0)
		end1 = lc.Curve.GetEndPoint(1)
		data.append([end0.X,end0.Y,end0.Z,end1.X,end1.Y,end1.Z,"BEAM",b.Name])
		eles.append(b)
	except:
		err.append(b)


for c in columns:
	try:
		end0 = c.Location.Point
		bBox = c.get_BoundingBox(None)#get top column point
		data.append([end0.X,end0.Y,end0.Z,end0.X,end0.Y,bBox.Max.Z,"COLUMN",c.Name])
		eles.append(c)
		
	except:
		err.append(C)

# Assign your output to the OUT variable.
OUT = data,eles
# ----------------------------------------
firstItem = List.FirstItem(list=get_beam_and_columns)
exportCSV = Data.ExportCSV(filePath=file_path, data=firstItem)
lastItem = List.LastItem(list=get_beam_and_columns)
solids = Element.Solids(element=lastItem)
